# Dynamo graph Export_excel.dyn (Dynamo 2.17.0.3472)

file_path = Filename("files\部屋集計.xlsx")
string = StringInput("room")
code_block = CodeBlock { 0; }
join = List.Join()  # unwired: list0, list1

# group: アプリ側のパラメータ名に変更する
string_2 = StringInput("project_info")
string_3 = StringInput("IfcGUID")
string_4 = StringInput("level")
string_5 = StringInput("No")
string_6 = StringInput("name")
string_7 = StringInput("wall_finish")
string_8 = StringInput("ceiling_finish")
string_9 = StringInput("floor_finish")
list_create = List.Create(item0=string_2, item1=string_3, item2=string_4, item3=string_5, item4=string_6, item5=string_7, item6=string_8, item7=string_9)

categories = Categories("OST_Rooms")
all_elements_of_category = ElementsOfCategory(Category=categories)
string_10 = StringInput("IfcGUID")
string_11 = StringInput("レベル")
string_12 = StringInput("番号")
string_13 = StringInput("名前")
string_14 = StringInput("仕上表 仕上 壁")
string_15 = StringInput("仕上表 仕上 天井")
string_16 = StringInput("仕上表 仕上 床")
list_create_2 = List.Create(item0=string_10, item1=string_11, item2=string_12, item3=string_13, item4=string_14, item5=string_15, item6=string_16)
getParameterValueByName = Element.GetParameterValueByName(element=all_elements_of_category, parameterName=list_create_2, lacing=CrossProduct)
transpose = List.Transpose(lists=getParameterValueByName)
アプリのプロジェクトID = DoubleInput(1)  # graph input
count = List.Count(list=all_elements_of_category)
cycle = List.Cycle(list=アプリのプロジェクトID, amount=count)
flatten = List.Flatten(list=cycle)
code_block_2 = CodeBlock { 0; }
insert = List.Insert(list=transpose, element=flatten, index=code_block_2)
code_block_3 = CodeBlock { 0; }
getItemAtIndex = List.GetItemAtIndex(list=insert, index=code_block_3@L2)
flatten_2 = List.Flatten(list=getItemAtIndex)
code_block_4 = CodeBlock { 1; }
getItemAtIndex_2 = List.GetItemAtIndex(list=insert, index=code_block_4@L2)
flatten_3 = List.Flatten(list=getItemAtIndex_2)
code_block_5 = CodeBlock { 2; }
getItemAtIndex_3 = List.GetItemAtIndex(list=insert, index=code_block_5@L2)
flatten_4 = List.Flatten(list=getItemAtIndex_3)

# group: レベルリスト
string_17 = StringInput("ピット")
string_18 = StringInput("1")
string_19 = StringInput("1FL")
string_20 = StringInput("2")
string_21 = StringInput("2FL")
string_22 = StringInput("3")
string_23 = StringInput("3FL")
string_24 = StringInput("4")
string_25 = StringInput("4FL")
string_26 = StringInput("5")
string_27 = StringInput("5FL")
string_28 = StringInput("6")
string_29 = StringInput("6FL")
string_30 = StringInput("7")
string_31 = StringInput("7FL")
string_32 = StringInput("8")
string_33 = StringInput("RSL")
string_34 = StringInput("9")

replace = String.Replace(string=flatten_4, searchFor=string_17, replaceWith=string_18)
replace_2 = String.Replace(string=replace, searchFor=string_19, replaceWith=string_20)
replace_3 = String.Replace(string=replace_2, searchFor=string_21, replaceWith=string_22)
replace_4 = String.Replace(string=replace_3, searchFor=string_23, replaceWith=string_24)
replace_5 = String.Replace(string=replace_4, searchFor=string_25, replaceWith=string_26)
replace_6 = String.Replace(string=replace_5, searchFor=string_27, replaceWith=string_28)
replace_7 = String.Replace(string=replace_6, searchFor=string_29, replaceWith=string_30)
replace_8 = String.Replace(string=replace_7, searchFor=string_31, replaceWith=string_32)
code_block_6 = CodeBlock { 3; }
getItemAtIndex_4 = List.GetItemAtIndex(list=insert, index=code_block_6@L2)
flatten_5 = List.Flatten(list=getItemAtIndex_4)
code_block_7 = CodeBlock { 4; }
getItemAtIndex_5 = List.GetItemAtIndex(list=insert, index=code_block_7@L2)
flatten_6 = List.Flatten(list=getItemAtIndex_5)

# group: FKをIDに置き換える
code_block_8 = CodeBlock { 5; }
getItemAtIndex_6 = List.GetItemAtIndex(list=insert, index=code_block_8@L2)
flatten_7 = List.Flatten(list=getItemAtIndex_6)
code_block_9 = CodeBlock { 6; }
getItemAtIndex_7 = List.GetItemAtIndex(list=insert, index=code_block_9@L2)
flatten_8 = List.Flatten(list=getItemAtIndex_7)
code_block_10 = CodeBlock { 7; }
getItemAtIndex_8 = List.GetItemAtIndex(list=insert, index=code_block_10@L2)
flatten_9 = List.Flatten(list=getItemAtIndex_8)

# group: 壁仕上リスト
string_35 = StringInput("_")
string_36 = StringInput("EP-2")
string_37 = StringInput("素地")
string_38 = StringInput("化粧塩ビシート(A)")
string_39 = StringInput("花こう岩(A)")

string_40 = StringInput("1")
replace_9 = String.Replace(string=flatten_7, searchFor=string_35, replaceWith=string_40)
string_41 = StringInput("2")
replace_10 = String.Replace(string=replace_9, searchFor=string_36, replaceWith=string_41)
string_42 = StringInput("3")
replace_11 = String.Replace(string=replace_10, searchFor=string_37, replaceWith=string_42)
string_43 = StringInput("4")
replace_12 = String.Replace(string=replace_11, searchFor=string_38, replaceWith=string_43)
string_44 = StringInput("5")
replace_13 = String.Replace(string=replace_12, searchFor=string_39, replaceWith=string_44)

# group: 天井仕上リスト
string_45 = StringInput("_")
string_46 = StringInput("岩綿吸音板(A)")
string_47 = StringInput("素地")
string_48 = StringInput("化粧GB(A)")
string_49 = StringInput("システム天井(A)")

string_50 = StringInput("1")
replace_14 = String.Replace(string=flatten_8, searchFor=string_45, replaceWith=string_50)
string_51 = StringInput("2")
replace_15 = String.Replace(string=replace_14, searchFor=string_46, replaceWith=string_51)
string_52 = StringInput("3")
replace_16 = String.Replace(string=replace_15, searchFor=string_47, replaceWith=string_52)
string_53 = StringInput("4")
replace_17 = String.Replace(string=replace_16, searchFor=string_48, replaceWith=string_53)
string_54 = StringInput("5")
replace_18 = String.Replace(string=replace_17, searchFor=string_49, replaceWith=string_54)

# group: 床仕上リスト
string_55 = StringInput("_")
string_56 = StringInput("ビニル床シート(A)")
string_57 = StringInput("防塵塗装(A)")
string_58 = StringInput("ビニル床シート(B)")
string_59 = StringInput("花こう岩(A)")
string_60 = StringInput("素地")
string_61 = StringInput("タイルカーペット(A)")

string_62 = StringInput("1")
replace_19 = String.Replace(string=flatten_9, searchFor=string_55, replaceWith=string_62)
string_63 = StringInput("2")
replace_20 = String.Replace(string=replace_19, searchFor=string_56, replaceWith=string_63)
string_64 = StringInput("3")
replace_21 = String.Replace(string=replace_20, searchFor=string_57, replaceWith=string_64)
string_65 = StringInput("4")
replace_22 = String.Replace(string=replace_21, searchFor=string_58, replaceWith=string_65)
string_66 = StringInput("5")
replace_23 = String.Replace(string=replace_22, searchFor=string_59, replaceWith=string_66)
string_67 = StringInput("6")
replace_24 = String.Replace(string=replace_23, searchFor=string_60, replaceWith=string_67)
string_68 = StringInput("7")
replace_25 = String.Replace(string=replace_24, searchFor=string_61, replaceWith=string_68)
string_69 = StringInput("防塵塗装(B)")
string_70 = StringInput("8")
replace_26 = String.Replace(string=replace_25, searchFor=string_69, replaceWith=string_70)
list_create_3 = List.Create(item0=flatten_2, item1=flatten_3, item2=replace_8, item3=flatten_5, item4=flatten_6, item5=replace_13, item6=replace_18, item7=replace_26)
combine = List.Combine(combineFunction=join, list0=list_create, list1=list_create_3)
transpose_2 = List.Transpose(lists=combine)
boolean = BoolSelector(true)
boolean_2 = BoolSelector(true)
exportToExcel = Data.ExportToExcel(filePath=file_path, sheetName=string, startRow=code_block, startColumn=code_block, data=transpose_2, overWrite=boolean, writeAsString=boolean_2)

# group: プロジェクト番号_取得
python_script = Python()  # CPython3
# ---------- python_script.python (39 lines) ----------
import sys
import clr
clr.AddReference('ProtoGeometry')
from Autodesk.DesignScript.Geometry import *
clr.AddReference("DSCoreNodes")
from DSCore import List
# このノードへの入力は、リスト形式で IN 変数に格納されます。
clr.AddReference("RevitAPI")
from Autodesk.Revit.DB import *

clr.AddReference ("RevitServices")
import RevitServices
from  RevitServices.Persistence import DocumentManager
from  RevitServices.Transactions import TransactionManager

doc = DocumentManager.Instance.CurrentDBDocument

pInfo = doc.ProjectInformation;

p_list = []
#a = {"PJ情報 設計番号","PJ情報 プロジェクト名","PJ情報 工事種別"}

parm1 = pInfo.LookupParameter("PJ情報 設計番号");
#parm2 = pInfo.LookupParameter("PJ情報 プロジェクト名");
#parm3 = pInfo.LookupParameter("PJ情報 工事種別");



st1 = parm1.AsString();
#st2 = parm2.AsString();
#st3 = parm3.AsString();

p_list.append(st1)
#p_list.append(st2)
#p_list.append(st3)
 

# 出力を OUT 変数に割り当てます。
OUT = p_list
# ----------------------------------------
list_create_4 = List.Create(item0=python_script)

replace_27 = String.Replace(string=replace_8, searchFor=string_33, replaceWith=string_34)
